vi "index.gviweb"   [LabVIEW NXG 4.0.0]
panel controls:
  "Polarity": bool
panel indicators:
  "Numeric": f64
diagram:
  # Place setup code before the loop. For example, perform initial data communication and wire the results into the loop.
  Property Node(instance in=reference to unnamed text, "Visible"=FALSE) -> (error out=w1)
  # Top-Level WebVIs usually contain a While Loop that never stops so that they can continue running as long as the web page is open in the user's web browser.
  while (after w1) {
    Random Number() -> (number (0 to 1)=w2)
    Multiply(w2, 100) -> w3
    case ($Polarity) {
      frame False, Default {
        Property Node(instance in=reference to unnamed text, "Visible"=FALSE)
        Negate(x=w3) -> w4
      }
      frame True {
        Property Node(instance in=reference to unnamed text, "Visible"=TRUE)
        w4 = w3
      }
    }
    Round To Nearest(number=w4) -> w5
    $Numeric <- w5
    Wait(time to wait=100)
    stop if FALSE
  }
